# Grasshopper definition Basics.gh (Grasshopper 1.0.7)
# plug-ins: GH_CPython, Human

path = FilePath("C:/OpenModelica/share/doc/omc/testmodels/")
gh_cpython = GH_CPython(input=0)  # -> output
#   port input: [required] - [type = int] - [default = None] Descripe your input here * bullet point. * bullet point
#   port output: indicate your output description here. refers to a new line.
# ---------- gh_cpython: Python ----------
import OMPython, modelica_language, modelicalang, pymoca, pyfmu, buildingspy, impactlib

from OMPython import OMCSessionZMQ
output = []
omc = OMCSessionZMQ()
output.append(omc.sendExpression("getVersion()"))
output.append(omc.sendExpression("loadModel(Modelica)"))
output.append(omc.sendExpression("loadFile(getInstallationDirectoryPath() + \"/share/doc/omc/testmodels/BouncingBall.mo\")"))
output.append(omc.sendExpression("instantiateModel(BouncingBall)"))
output.append(omc.sendExpression("simulate(BouncingBall, stopTime=3.0)"))
omc.sendExpression("val(h , 2.0)")

output_ = str(omc) + '\n'.join(map(str, output))
# ---------- end gh_cpython ----------
# Get .mo file and file name
folder = Panel(path)
dir = DirectoryContents(FolderPath=path, Filter="*.mo", IncludeSubfolders=False)  # -> FilePaths, FileNames
entwine = Entwine(Branch00=dir.FilePaths, Branch01=dir.FileNames, FlattenInputs=True)  # -> simplify(Result)
# Import and test libraries
panel = Panel(gh_cpython)
item = ListItem(List=entwine, Index=Slider(2, range=0..10), Wrap=True)
panel_2 = Panel(item)
bang = ExplodeTree(Data=item)  # -> Branch0, Branch1
# Read Class
read_mo_file = ReadMoFile(ModelPath=bang.Branch0, ClassName=bang.Branch1)  # -> output; inputs ClassName: list
#   port ModelPath: [required] - [type = int] - [default = None] Descripe your input here * bullet point. * bullet point
#   port output: indicate your output description here. refers to a new line.
# ---------- read_mo_file: Python ----------
from OMPython import OMCSessionZMQ
from pathlib import Path    

#FileName = Path(FilePath).name.split(".")[0]
ModelPath = ModelPath.replace("\t", "/t")
print(ModelPath)

omc = OMCSessionZMQ()
omc.sendExpression("loadFile(" + '"' + ModelPath +'")')
#Print Expression
print("loadFile(" + '"' + ModelPath +'")')
output_ = omc.sendExpression("instantiateModel("+ClassName+")")
# ---------- end read_mo_file ----------
# Simulate model
gh_cpython_2 = GH_CPython(ModelPath=bang.Branch0, ClassName=bang.Branch1, RunSimulation=Toggle(True))  # -> output, ModelPath, Quantities, SimOptions, Solutions; inputs ModelPath: list, ClassName: list, RunSimulation: list
#   port output: indicate your output description here. refers to a new line.
# ---------- gh_cpython_2: Python ----------
from OMPython import OMCSessionZMQ
omc = OMCSessionZMQ()

#ModelPath=omc.sendExpression("getInstallationDirectoryPath()") + "/share/doc/omc/testmodels/" + "BouncingBall.mo"
from OMPython import ModelicaSystem
mod=ModelicaSystem(ModelPath,ClassName)
#3 arguments #mod=ModelicaSystem(ModelPath, ClassName, ["Modelica"])
#4 arguments #mod=ModelicaSystem(ModelPath, ClassName, commandLineOptions="-d=newInst")
Quantities = mod.getQuantities()
SimOptions = mod.getSimulationOptions()

if RunSimulation == True:
    mod.simulate()
    Solutions = list(mod.getSolutions())
else:
    Solutions = mod.getSolutions()
# ---------- end gh_cpython_2 ----------
panel_3 = Panel(read_mo_file)
data = Data(gh_cpython_2.SimOptions)
keyvalues = GhPythonScript(dict=data)  # -> out, keys, values
# ---------- keyvalues: Python ----------
__author__ = "amd"
__version__ = "2020.07.06"

dict = eval(dict)
keys = []
values = []
for key, value in dict.items():
    keys.append(key)
    values.append(value)
# ---------- end keyvalues ----------
solutions = Panel(gh_cpython_2.Solutions)
simulation_options_dictionary = Panel(data)
quantities = Panel(gh_cpython_2.Quantities)
list = ItemSelector(keyvalues.keys, {"tolerance", "stopTime", "solver", "stepSize", "startTime"}, selected="solver")
getvaluebykey = GhPythonScript(dict=data, key=list)  # -> out, value
# ---------- getvaluebykey: Python ----------
__author__ = "amd"
__version__ = "2020.07.06"

dict = eval(dict)
value = dict.get(key)
# ---------- end getvaluebykey ----------
panel_4 = Panel(getvaluebykey.value)
