# Grasshopper definition JModelica.gh (Grasshopper 1.0.7)
# plug-ins: GH_CPython

python_3_8 = Panel("C:\Users\amd\AppData\Local\Programs\Python\Python38\python.exe")
# Works with python 2 but not with python 3
python_2_7 = Panel("C:\JModelica.org-2.14\Python27\Python_64\python.exe")
gh_cpython = GH_CPython(input=0)  # -> output, a; inputs input: list
# ---------- gh_cpython: Python ----------
# -*- coding: utf-8 -*-
""" 
Python Script
Created on  Wednesday July 2020 01:45:06 
@author:  amd 

[desc]
Description of the plugin Here
Write here any thing... 
[/desc]

ARGUMENTS:
----------
<inp> 
    _input :[required] - [type = int] - [default = None] 
    Descripe your input here 
        * bullet point.
        * bullet point
</inp>
<inp>
    Other inputs go here ...
</inp>

RETURN:
----------
    <out>
        output_ : indicate your output description here. \n refers to a new line.
    </out>

"""
import setenv

# Import and run the fmi_bouncing_ball example and plot results
from pyfmi.examples import fmi_bouncing_ball
fmi_bouncing_ball.run_demo()
# ---------- end gh_cpython ----------
gh_cpython_2 = GH_CPython(input=0)  # -> output; inputs input: list; disabled
# ---------- gh_cpython_2: Python ----------
# -*- coding: utf-8 -*-
""" 
Python Script
Created on  Wednesday July 2020 12:05:52 
@author:  amd 

[desc]
Description of the plugin Here
Write here any thing... 
[/desc]

ARGUMENTS:
----------
<inp> 
    _input :[required] - [type = int] - [default = None] 
    Descripe your input here 
        * bullet point.
        * bullet point
</inp>
<inp>
    Other inputs go here ...
</inp>

RETURN:
----------
    <out>
        output_ : indicate your output description here. \n refers to a new line.
    </out>

"""
import setenv
#Import and run the CSTR example using CasADi and plot results
from pyjmi.examples import cstr_casadi
cstr_casadi.run_demo()
# ---------- end gh_cpython_2 ----------
