# Grasshopper definition OpenModelica.gh (Grasshopper 1.0.7)
# plug-ins: GH_CPython, Human

help_ompython = Data("""Help on package OMPython:

NAME
    OMPython

DESCRIPTION
    OMPython is a Python interface to OpenModelica.
    To get started, create an OMCSession/OMCSessionZMQ object:
    from OMPython import OMCSession/OMCSessionZMQ
    omc = OMCSession()/OMCSessionZMQ()
    omc.sendExpression(command)
    
    Note: Conversion from OMPython 1.0 to OMPython 2.0 is very simple
    1.0:
    import OMPython
    OMPython.execute(command)
    2.0:
    from OMPython import OMCSession
    OMPython = OMCSession()
    OMPython.execute(command)
    
    OMPython 3.0 includes a new class OMCSessionZMQ uses PyZMQ to communicate
    with OpenModelica. A new argument `useCorba=False` is added to ModelicaSystem
    class which means it will use OMCSessionZMQ by default. If you want to use
    OMCSession then create ModelicaSystem object like this,
    obj = ModelicaSystem(useCorba=True)
    
    The difference between execute and sendExpression is the type of the
    returned expression. sendExpression maps Modelica types to Python types,
    while execute tries to map also output that is not valid Modelica.
    That format is harder to use.

PACKAGE CONTENTS
    OMParser (package)
    OMTypedParser

CLASSES
    builtins.object
        ModelicaSystem
        OMCSessionBase
        OMCSessionHelper
            OMCSession(OMCSessionHelper, OMCSessionBase)
            OMCSessionZMQ(OMCSessionHelper, OMCSessionBase)
    
    class ModelicaSystem(builtins.object)
     |  ModelicaSystem(fileName=None, modelName=None, lmodel=[], useCorba=False, commandLineOptions=None)
     |  
     |  Methods defined here:
     |  
     |  __del__(self)
     |  
     |  __init__(self, fileName=None, modelName=None, lmodel=[], useCorba=False, commandLineOptions=None)
     |      "constructor"
     |      It initializes to load file and build a model, generating object, exe, xml, mat, and json files. etc. It can be called :
     |          •without any arguments: In this case it neither loads a file nor build a model. This is useful when a FMU needed to convert to Modelica model
     |          •with two arguments as file name with ".mo" extension and the model name respectively
     |          •with three arguments, the first and second are file name and model name respectively and the third arguments is Modelica standard library to load a model, which is common in such models where the model is based on the standard library. For example, here is a model named "dcmotor.mo" below table 4-2, which is located in the directory of OpenModelica at "C:\OpenModelica1.9.4-dev.beta2\share\doc\omc    estmodels".
     |      Note: If the model file is not in the current working directory, then the path where file is located must be included together with file name. Besides, if the Modelica model contains several different models within the same package, then in order to build the specific model, in second argument, user must put the package name with dot(.) followed by specific model name.
     |      ex: myModel = ModelicaSystem("ModelicaModel.mo", "modelName")
     |  
     |  buildModel(self)
     |  
     |  checkValidInputs(self, name)
     |  
     |  convertFmu2Mo(self, fmuName)
     |      In order to load FMU, at first it needs to be translated into Modelica model. This method is used to generate Modelica model from the given FMU. It generates "fmuName_me_FMU.mo".
     |      Currently, it only supports Model Exchange conversion.
     |      usage
     |      >>> convertFmu2Mo("c:/BouncingBall.Fmu")
     |  
     |  convertMo2Fmu(self)
     |      This method is used to generate FMU from the given Modelica model. It creates "modelName.fmu" in the current working directory. It can be called:
     |      only without any arguments
     |      usage
     |      >>> convertMo2Fmu()
     |  
     |  getContinuous(self, names=None)
     |      This method returns dict. The key is continuous names and value is corresponding continuous value.
     |      usage:
     |      >>> getContinuous()
     |      >>> getContinuous("Name1")
     |      >>> getContinuous(["Name1","Name2"])
     |  
     |  getInputs(self, names=None)
     |      This method returns dict. The key is input names and value is corresponding input value.
     |      If *name is None then the function will return dict which contain all input names as key and value as corresponding values. eg., getInputs()
     |      Otherwise variable number of arguments can be passed as input name in string format separated by commas. eg., getInputs('iName1', 'iName2')
     |  
     |  getLinearInputs(self)
     |      function which returns the LinearInputs after Linearization is performed
     |      usage
     |      >>> getLinearInputs()
     |  
     |  getLinearMatrixValues(self, matrix)
     |      Helper Function which generates the Linear Matrix A,B,C,D
     |  
     |  getLinearOutputs(self)
     |      function which returns the LinearInputs after Linearization is performed
     |      usage
     |      >>> getLinearOutputs()
     |  
     |  getLinearStates(self)
     |      function which returns the LinearInputs after Linearization is performed
     |      usage
     |      >>> getLinearStates()
     |  
     |  getLinearizationOptions(self, names=None)
     |      This method returns dict. The key is linearize option names and value is corresponding linearize option value.
     |      If name is None then the function will return dict which contain all linearize option names as key and value as corresponding values. eg., getLinearizationOptions()
     |      usage:
     |      >>> getLinearizationOptions()
     |      >>> getLinearizationOptions("Name1")
     |      >>> getLinearizationOptions(["Name1","Name2"])
     |  
     |  getOptimizationOptions(self, names=None)
     |      usage:
     |      >>> getOptimizationOptions()
     |      >>> getOptimizationOptions("Name1")
     |      >>> getOptimizationOptions(["Name1","Name2"])
     |  
     |  getOutputs(self, names=None)
     |      This method returns dict. The key is output names and value is corresponding output value.
     |      If name is None then the function will return dict which contain all output names as key and value as corresponding values. eg., getOutputs()
     |      usage:
     |      >>> getOutputs()
     |      >>> getOutputs("Name1")
     |      >>> getOutputs(["Name1","Name2"])
     |  
     |  getParameters(self, names=None)
     |      This method returns dict. The key is parameter names and value is corresponding parameter value.
     |      If name is None then the function will return dict which contain all parameter names as key and value as corresponding values.
     |      usage:
     |      >>> getParameters()
     |      >>> getParameters("Name1")
     |      >>> getParameters(["Name1","Name2"])
     |  
     |  getQuantities(self, names=None)
     |      This method returns list of dictionaries. It displays details of quantities such as name, value, changeable, and description, where changeable means  if value for corresponding quantity name is changeable or not. It can be called :       
     |      usage:
     |      >>> getQuantities()
     |      >>> getQuantities("Name1")
     |      >>> getQuantities(["Name1","Name2"])
     |  
     |  getSimulationOptions(self, names=None)
     |      This method returns dict. The key is simulation option names and value is corresponding simulation option value.
     |      If name is None then the function will return dict which contain all simulation option names as key and value as corresponding values. eg., getSimulationOptions()
     |      usage:
     |      >>> getSimulationOptions()
     |      >>> getSimulationOptions("Name1")
     |      >>> getSimulationOptions(["Name1","Name2"])
     |  
     |  getSolutions(self, varList=None, resultfile=None)
     |      This method returns tuple of numpy arrays. It can be called:
     |          •with a list of quantities name in string format as argument: it returns the simulation results of the corresponding names in the same order. Here it supports Python unpacking depending upon the number of variables assigned.
     |      usage:
     |      >>> getSolutions()
     |      >>> getSolutions("Name1")
     |      >>> getSolutions(["Name1","Name2"])
     |      >>> getSolutions(resultfile="c:/a.mat")
     |      >>> getSolutions("Name1",resultfile=""c:/a.mat"")
     |      >>> getSolutions(["Name1","Name2"],resultfile=""c:/a.mat"")
     |  
     |  getlinearMatrix(self)
     |      Helper Function which generates the Linear Matrix A,B,C,D
     |  
     |  getlinearParameters(self, names=None)
     |      This method returns dict. The key is parameter names and value is corresponding parameter value.
     |      If *name is None then the function will return dict which contain all parameter names as key and value as corresponding values. eg., getParameters()
     |      Otherwise variable number of arguments can be passed as parameter name in string format separated by commas. eg., getParameters('paraName1', 'paraName2')
     |  
     |  linearize(self)
     |      This method linearizes model according to the linearized options. This will generate a linear model that consists of matrices A, B, C and D.  It can be called:
     |      only without any arguments
     |      usage
     |      >>> linearize()
     |  
     |  optimize(self)
     |      This method optimizes model according to the optimized options. It can be called:
     |      only without any arguments
     |      usage
     |      >>> optimize()
     |  
     |  requestApi(self, apiName, entity=None, properties=None)
     |      # request to OMC
     |  
     |  sendExpression(self, expr, parsed=True)
     |  
     |  setContinuous(self, cvals)
     |      This method is used to set continuous values. It can be called:
     |      with a sequence of continuous name and assigning corresponding values as arguments as show in the example below:
     |      usage
     |      >>> setContinuous("Name=value")
     |      >>> setContinuous(["Name1=value1","Name2=value2"])
     |  
     |  setInputs(self, name)
     |      This method is used to set input values. It can be called:
     |      with a sequence of input name and assigning corresponding values as arguments as show in the example below:
     |      usage
     |      >>> setInputs("Name=value")
     |      >>> setInputs(["Name1=value1","Name2=value2"])
     |  
     |  setLinearizationOptions(self, linearizationOptions)
     |      This method is used to set linearization options. It can be called:
     |      with a sequence of linearization options name and assigning corresponding value as arguments as show in the example below
     |      usage
     |      >>> setLinearizationOptions("Name=value")
     |      >>> setLinearizationOptions(["Name1=value1","Name2=value2"])
     |  
     |  setMethodHelper(self, args1, args2, args3, args4=None)
     |      Helper function for setParameter(),setContinuous(),setSimulationOptions(),setLinearizationOption(),setOptimizationOption()
     |      args1 - string or list of string given by user
     |      args2 - dict() containing the values of different variables(eg:, parameter,continuous,simulation parameters)
     |      args3 - function name (eg; continuous, parameter, simulation, linearization,optimization)
     |      args4 - dict() which stores the new override variables list,
     |  
     |  setOptimizationOptions(self, optimizationOptions)
     |      This method is used to set optimization options. It can be called:
     |      with a sequence of optimization options name and assigning corresponding values as arguments as show in the example below:
     |      usage
     |      >>> setOptimizationOptions("Name=value")
     |      >>> setOptimizationOptions(["Name1=value1","Name2=value2"])
     |  
     |  setParameters(self, pvals)
     |      This method is used to set parameter values. It can be called:
     |      with a sequence of parameter name and assigning corresponding value as arguments as show in the example below:
     |      usage
     |      >>> setParameters("Name=value")
     |      >>> setParameters(["Name1=value1","Name2=value2"])
     |  
     |  setSimulationOptions(self, simOptions)
     |      This method is used to set simulation options. It can be called:
     |      with a sequence of simulation options name and assigning corresponding values as arguments as show in the example below:
     |      usage
     |      >>> setSimulationOptions("Name=value")
     |      >>> setSimulationOptions(["Name1=value1","Name2=value2"])
     |  
     |  simulate(self, resultfile=None, simflags=None)
     |      This method simulates model according to the simulation options.
     |      usage
     |      >>> simulate()
     |      >>> simulate(resultfile="a.mat")
     |      >>> simulate(simflags="-noEventEmit -noRestart -override=e=0.3,g=10) set runtime simulation flags
     |  
     |  strip_space(self, name)
     |  
     |  xmlparse(self)
     |  
     |  ----------------------------------------------------------------------
     |  Data descriptors defined here:
     |  
     |  __dict__
     |      dictionary for instance variables (if defined)
     |  
     |  __weakref__
     |      list of weak references to the object (if defined)
    
    class OMCSession(OMCSessionHelper, OMCSessionBase)
     |  OMCSession(readonly=False, serverFlag='--interactive=corba', timeout=0.25)
     |  
     |  Method resolution order:
     |      OMCSession
     |      OMCSessionHelper
     |      OMCSessionBase
     |      builtins.object
     |  
     |  Methods defined here:
     |  
     |  __del__(self)
     |  
     |  __init__(self, readonly=False, serverFlag='--interactive=corba', timeout=0.25)
     |      Initialize self.  See help(type(self)) for accurate signature.
     |  
     |  execute(self, command)
     |  
     |  sendExpression(self, command, parsed=True)
     |      Sends an expression to the OpenModelica. The return type is parsed as if the
     |      expression was part of the typed OpenModelica API (see ModelicaBuiltin.mo).
     |      * Integer and Real are returned as Python numbers
     |      * Strings, enumerations, and typenames are returned as Python strings
     |      * Arrays, tuples, and MetaModelica lists are returned as tuples
     |      * Records are returned as dicts (the name of the record is lost)
     |      * Booleans are returned as True or False
     |      * NONE() is returned as None
     |      * SOME(value) is returned as value
     |  
     |  ----------------------------------------------------------------------
     |  Data and other attributes defined here:
     |  
     |  __abstractmethods__ = frozenset()
     |  
     |  ----------------------------------------------------------------------
     |  Data descriptors inherited from OMCSessionHelper:
     |  
     |  __dict__
     |      dictionary for instance variables (if defined)
     |  
     |  __weakref__
     |      list of weak references to the object (if defined)
     |  
     |  ----------------------------------------------------------------------
     |  Methods inherited from OMCSessionBase:
     |  
     |  ask(self, question, opt=None, parsed=True)
     |  
     |  getClassComment(self, className)
     |  
     |  getClassNames(self, className=None, recursive=False, qualified=False, sort=False, builtin=False, showProtected=False)
     |      # function getClassNames
     |      #   input TypeName class_ = $Code(AllLoadedClasses);
     |      #   input Boolean recursive = false;
     |      #   input Boolean qualified = false;
     |      #   input Boolean sort = false;
     |      #   input Boolean builtin = false "List also builtin classes if true";
     |      #   input Boolean showProtected = false "List also protected classes if true";
     |      #   output TypeName classNames[:];
     |      # end getClassNames;
     |  
     |  getClassRestriction(self, className)
     |  
     |  getComponentModifierNames(self, className, componentName)
     |  
     |  getComponentModifierValue(self, className, componentName)
     |  
     |  getComponents(self, className)
     |  
     |  getDerivedClassModifierNames(self, className)
     |  
     |  getDerivedClassModifierValue(self, className, modifierName)
     |  
     |  getExtendsModifierNames(self, className, componentName)
     |  
     |  getExtendsModifierValue(self, className, extendsName, modifierName)
     |  
     |  getImportCount(self, className)
     |  
     |  getInheritanceCount(self, className)
     |  
     |  getNthComponent(self, className, comp_id)
     |      returns with (type, name, description)
     |  
     |  getNthComponentAnnotation(self, className, comp_id)
     |  
     |  getNthComponentModification(self, className, comp_id)
     |  
     |  getNthImport(self, className, importNumber)
     |  
     |  getNthInheritedClass(self, className, inheritanceDepth)
     |  
     |  getPackages(self, className='AllLoadedClasses')
     |  
     |  getParameterNames(self, className)
     |  
     |  getParameterValue(self, className, parameterName)
     |  
     |  isBlock(self, className)
     |  
     |  isClass(self, className)
     |  
     |  isConnector(self, className)
     |  
     |  isConstant(self, className)
     |  
     |  isFunction(self, className)
     |  
     |  isModel(self, className)
     |  
     |  isPackage(self, className)
     |  
     |  isParameter(self, className)
     |  
     |  isPrimitive(self, className)
     |  
     |  isProtected(self, className)
     |  
     |  isRecord(self, className)
     |  
     |  isType(self, className)
     |  
     |  loadFile(self, filename)
     |      # TODO: Open Modelica Compiler API functions. Would be nice to generate these.
     |  
     |  loadModel(self, className)
     |  
     |  typeNameStrings(self, className)
    
    class OMCSessionBase(builtins.object)
     |  OMCSessionBase(readonly=False)
     |  
     |  Methods defined here:
     |  
     |  __del__(self)
     |  
     |  __init__(self, readonly=False)
     |      Initialize self.  See help(type(self)) for accurate signature.
     |  
     |  ask(self, question, opt=None, parsed=True)
     |  
     |  execute(self, command)
     |      # FIXME: we should have one function which interacts with OMC. Either execute OR sendExpression.
     |      # Execute uses OMParser.check_for_values and sendExpression uses OMTypedParser.parseString.
     |      # We should have one parser. Then we can get rid of one of these functions.
     |  
     |  getClassComment(self, className)
     |  
     |  getClassNames(self, className=None, recursive=False, qualified=False, sort=False, builtin=False, showProtected=False)
     |      # function getClassNames
     |      #   input TypeName class_ = $Code(AllLoadedClasses);
     |      #   input Boolean recursive = false;
     |      #   input Boolean qualified = false;
     |      #   input Boolean sort = false;
     |      #   input Boolean builtin = false "List also builtin classes if true";
     |      #   input Boolean showProtected = false "List also protected classes if true";
     |      #   output TypeName classNames[:];
     |      # end getClassNames;
     |  
     |  getClassRestriction(self, className)
     |  
     |  getComponentModifierNames(self, className, componentName)
     |  
     |  getComponentModifierValue(self, className, componentName)
     |  
     |  getComponents(self, className)
     |  
     |  getDerivedClassModifierNames(self, className)
     |  
     |  getDerivedClassModifierValue(self, className, modifierName)
     |  
     |  getExtendsModifierNames(self, className, componentName)
     |  
     |  getExtendsModifierValue(self, className, extendsName, modifierName)
     |  
     |  getImportCount(self, className)
     |  
     |  getInheritanceCount(self, className)
     |  
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""")
# Get .mo filepath and file name
path = FilePath("C:\OpenModelica\share\doc\omc\testmodels\")
panel = Panel(help_ompython)
quicktest = GH_CPython()  # -> output; disabled
#   port output: indicate your output description here. refers to a new line.
# ---------- quicktest: Python ----------
from OMPython import OMCSessionZMQ
output = []
omc = OMCSessionZMQ()
output.append(omc.sendExpression("getVersion()"))
output.append(omc.sendExpression("loadModel(Modelica)"))
output.append(omc.sendExpression("loadFile(getInstallationDirectoryPath() + \"/share/doc/omc/testmodels/BouncingBall.mo\")"))
output.append(omc.sendExpression("instantiateModel(BouncingBall)"))
output.append(omc.sendExpression("simulate(BouncingBall, stopTime=3.0)"))
output.append(omc.sendExpression("val(h , 2.0)"))

output_ = '\n'.join(map(str, output))
# ---------- end quicktest ----------
rep = ReplaceText(Text=path, Find="\", Replace="/", RecursiveReplace=False)
# TODO
# 1. Change simulation directory, currently files end up in C:\Program Files\Rhino 7 WIP\System
# or in C:\Users\user\Desktop
# 2. Open results from .mat file
# 3. Issue with colons in outputs, how to create lists and datatrees from GH_CPython?
# 4. ...Implement more functions
# Different python modules to test: import OMPython, modelica_language, modelicalang, pymoca, pyfmu, buildingspy, impactlib
# Import and test libraries
panel_2 = Panel(quicktest)
folder = Panel(rep)
dir = DirectoryContents(FolderPath=rep, Filter="*.mo", IncludeSubfolders=False)  # -> FilePaths, FileNames
entwine = Entwine(Branch00=dir.FilePaths, Branch01=dir.FileNames, FlattenInputs=True)  # -> simplify(Result)
item = ListItem(List=entwine, Index=Slider(0, range=0..10), Wrap=True)
file = ReadFile(File="C:\OpenModelica\share\doc\omc\testmodels\sim_dcmotor.mos", PerLineParse=True)
panel_3 = Panel(item)
original_mos = Panel(file)
# OMShell CMDs: https://build.openmodelica.org/Documentation/OpenModelica.Scripting.html
refactor_mos = GhPythonScript(x=file)  # -> a; inputs x: list
# ---------- refactor_mos: Python ----------
__author__ = "amd"
__version__ = "2020.07.09"

print type(x)

a = [item.strip() for item in x]
old = 'loadFile("'
new = 'loadFile(getInstallationDirectoryPath() + "/share/doc/omc/testmodels/'
for i in range(len(a)):
    a[i]=a[i].replace(old,new)
    a[i]=a[i].replace(";","")

a = ["'"+item+"'" for item in a]
# ---------- end refactor_mos ----------
converted_mos = Panel(refactor_mos)
bang = ExplodeTree(Data=item)  # -> Branch0, Branch1
panel_4 = Panel("""e=0.7
g=9.81""")
panel_5 = Panel("""stopTime=2.0
tolerance=1e-07""")
item_2 = ListItem(List=entwine, Index=Slider(8, range=0..10), Wrap=True)
# Run multiple commands
# (scripts .mos)
toggle = BooleanToggle(False)
bang_2 = ExplodeTree(Data=item_2)  # -> Branch0, Branch1
# Simulate
simulateclass = SimulateClass(
    Mo=bang.Branch0,
    ClassName=bang.Branch1,
    SetInputs="Introduction = 77.0",
    SetPar=panel_4,
    SetParOpt=panel_5,
    RunSim=Toggle(True))  # -> Mo, Inputs, Outputs, Quantities, Parameters, SimOptions, Solutions; inputs Mo: list, ClassName: list, SetInputs: list, SetPar: list, SetParOpt: list, RunSim: list; disabled
# ---------- simulateclass: Python ----------
# -*- coding: utf-8 -*-
""" 
Python Script
Created on  Monday September 2020 11:09:53 
@author:  amd 

[desc]
Description of the plugin Here
Write here any thing... 
[/desc]

ARGUMENTS:
----------
<inp> 
    Mo :[required] - [type = int] - [default = None] 
    Descripe your input here 
        * bullet point.
        * bullet point
</inp>
<inp>
    ClassName :[required] - [type = int] - [default = None] 
    Descripe your input here 
        * bullet point.
        * bullet point
</inp>

RETURN:
----------
    <out>
        output_ : indicate your output description here. \n refers to a new line.
    </out>

"""

from OMPython import ModelicaSystem, OMCSessionZMQ

#Input Model
mod=ModelicaSystem(Mo,ClassName) #2 arguments
#mod=ModelicaSystem(ModelPath, ClassName, ["Modelica"]) #3 arguments 
#mod=ModelicaSystem(ModelPath, ClassName, commandLineOptions="-d=newInst") #4 arguments

#Set
mod.setInputs(SetInputs)
mod.setParameters(SetPar)
mod.setSimulationOptions(SetParOpt)
#Outputs
Inputs = mod.getInputs()
Outputs = mod.getOutputs()
Quantities = mod.getQuantities()
Parameters = mod.getParameters()
SimOptions = mod.getSimulationOptions()
if RunSim == True:
    mod.simulate()
    #mod.simulate(resultfile="tmpbouncingBall.mat")    
    Solutions = list(mod.getSolutions())
    #Solutions = mod.getSolutions(["time","height"])
else:
    Solutions = mod.getSolutions()
Mo = mod
# ---------- end simulateclass ----------
runcmds = RunCMDs(CMDs=converted_mos, Run=toggle)  # -> output; inputs CMDs: list, Run: list
# ---------- runcmds: Python ----------
# -*- coding: utf-8 -*-
""" 
Python Script
Created on  Wednesday July 2020 12:06:08 
@author:  amd 

[desc]
Component runs multiple commands
[/desc]

ARGUMENTS:
----------
<inp> 
    cmds :[required] - [type = list] - [default = None] 
    Descripe your input here 
        * first commands
        * seconds commands
</inp>
<inp>
        Run :[required] - [type = bool] - [default = False] 
    Descripe your input here 
        * True to run
        * False to stop
</inp>

RETURN:
----------
    <out>
        output : output from commands
    </out>



"""
#For example
#cmds = ['loadFile(getInstallationDirectoryPath() + "/share/doc/omc/testmodels/BouncingBall.mo")',
#"simulate(BouncingBall)",
#"plot(h)"]
#Run = True


from OMPython import OMCSessionZMQ
if Run:
    omc = OMCSessionZMQ()
    output = []
    for command in CMDs:
        #change parentheses
        command = command.replace("[","{").replace("]","}")
        answer = omc.sendExpression(command)
        #print(cmd)
        output.append("\n{}:\n{}".format(command, answer))
else:
    output = "False"
# ---------- end runcmds ----------
panel_6 = Panel(bang_2.Branch1)
# Open
panel_7 = Panel(bang_2.Branch0)
# Read
readclass = ReadMoFile(Path=bang_2.Branch0, Name=bang_2.Branch1)  # -> Content, Names, Type; inputs Name: list
#   port Path: [required] - [type = int] - [default = None] Descripe your input here * bullet point. * bullet point
#   port Content: indicate your output description here. refers to a new line.
# ---------- readclass: Python ----------
from OMPython import OMCSessionZMQ  

omc = OMCSessionZMQ()
omc.sendExpression('loadFile("' + Path +'")')
#print("loadFile(" + ModelPath + '")') #Print Expression

def whatisthat(Name):
    options = ['Block','Class','Model','Connector','Constant','Function',
               'Package','Parameter','Primitive','Protected','Record','Type']
    for item in options:
        if omc.sendExpression('is'+item+'('+Name+')') == True:
            answer = item
    return answer

Content = omc.sendExpression('instantiateModel('+ Name +')')
Names = list(omc.sendExpression('getClassNames()'))
print(Names)
Type = whatisthat(Name)
# ---------- end readclass ----------
panel_8 = Panel(runcmds)
parameters = Panel(simulateclass.Parameters)
inputs = Panel(simulateclass.Inputs)
panel_9 = Panel(readclass.Type)
panel_10 = Panel(readclass.Content)
text_trim = TextTrim(Text=readclass.Names, Start=True, End=True)
open_in_omedit = GhPythonScript(Mo=panel_7, Open=Toggle(False))  # -> Mo
# ---------- open_in_omedit: Python ----------
from subprocess import call

Exe = "C:/OpenModelica/bin/OMEdit.exe"
#Mo = "C:/OpenModelica/share/doc/omc/testmodels/SimpleIntegrator.mo"
#Open = True

if Open == True:
    call([Exe, Mo])
# ---------- end open_in_omedit ----------
text_trim_2 = TextTrim(Text=simulateclass.Solutions, Start=True, End=True)
data = Data(simulateclass.SimOptions)
panel_11 = Panel(text_trim)
solutions = Panel(text_trim_2)
keyvalues = GhPythonScript(dict=data)  # -> keys, values
# ---------- keyvalues: Python ----------
__author__ = "amd"
__version__ = "2020.07.06"

dict = eval(dict)
keys = []
values = []
for key, value in dict.items():
    keys.append(key)
    values.append(value)
# ---------- end keyvalues ----------
quantities = Panel(simulateclass.Quantities)
simulation_options = Panel(data)
list = ItemSelector(keyvalues.keys)
getvaluebykey = GhPythonScript(dict=data, key=list)  # -> value
# ---------- getvaluebykey: Python ----------
__author__ = "amd"
__version__ = "2020.07.06"

dict = eval(dict)
value = dict.get(key)
# ---------- end getvaluebykey ----------
panel_12 = Panel(getvaluebykey)
# Convert .mo -> .fmu -> .mo
panel_13 = Panel("C:/OpenModelica/share/doc/omc/testmodels/dcmotor.mo")
# Contents of study folder
panel_14 = Panel("C:/Users/amd/Documents/GitHub/Modelica-Grasshopper/Grasshopper")
om_studyfolder = OMStudyFolder(dir="C:/Users/amd/Desktop/Test")  # -> StudyFolder; inputs dir: list; disabled
# ---------- om_studyfolder: Python ----------
# -*- coding: utf-8 -*-
""" 
Python Script
Created on  Monday September 2020 10:55:15 
@author:  amd 

[desc]
Description of the plugin Here
Write here any thing... 
[/desc]

ARGUMENTS:
----------
<inp> 
    dir :[optional] - [type = string] - [default = None] 
    Directory path for alternative StudyFolder
        * bullet point.
        * bullet point
</inp>
<inp>
    Other inputs go here ...
</inp>

RETURN:
----------
    <out>
        output : indicate your output description here. \n refers to a new line.
    </out>

"""

from OMPython import OMCSessionZMQ  
omc = OMCSessionZMQ()

if dir is not None:
    StudyFolder = omc.sendExpression('cd("'+dir+'")')
StudyFolder = omc.sendExpression('cd()')
# ---------- end om_studyfolder ----------
gh_cpython = GH_CPython(Mo=panel_13)  # -> FMU; inputs Mo: list; disabled
# ---------- gh_cpython: Python ----------
# -*- coding: utf-8 -*-
""" 
Python Script
Created on  Thursday July 2020 12:32:39 
@author:  amd 

[desc]
Description of the plugin Here
Write here any thing... 
[/desc]

ARGUMENTS:
----------
<inp> 
    _input :[required] - [type = int] - [default = None] 
    Descripe your input here 
        * bullet point.
        * bullet point
</inp>
<inp>
    Other inputs go here ...
</inp>

RETURN:
----------
    <out>
        output_ : indicate your output description here. \n refers to a new line.
    </out>

"""

from OMPython import OMCSessionZMQ, ModelicaSystem
omc = OMCSessionZMQ()
omc.sendExpression('loadFile("' + Mo +'")')

def whatisthat(Name):
    options = ['Block','Class','Model','Connector','Constant','Function',
               'Package','Parameter','Primitive','Protected','Record','Type']
    for item in options:
        if omc.sendExpression('is'+item+'('+Name+')') == True:
            answer = item
    return answer

Names = list(omc.sendExpression('getClassNames()'))
Type = whatisthat(Names[0])

print(Names)
if Type == "Class" or Type == "Model":
    mod=ModelicaSystem(Mo,Names[0])
    FMU = mod.convertMo2Fmu()
else:
    FMU = "Supply model or class"
# ---------- end gh_cpython ----------
panel_15 = Panel(om_studyfolder)  # disabled
directory_contents = DirectoryContents(FolderPath=panel_14, Filter="*", IncludeSubfolders=False)  # -> FilePaths, FileNames
modelica_folder = ModelicaFolder(StudyFolder=om_studyfolder)  # -> files; inputs StudyFolder: list; disabled
# ---------- modelica_folder: Python ----------
# -*- coding: utf-8 -*-
""" 
Python Script
Created on  Thursday July 2020 03:11:43 
@author:  amd 

[desc]
Description of the plugin Here
Write here any thing... 
[/desc]

ARGUMENTS:
----------
<inp> 
    _input :[required] - [type = int] - [default = None] 
    Descripe your input here 
        * bullet point.
        * bullet point
</inp>
<inp>
    Other inputs go here ...
</inp>

RETURN:
----------
    <out>
        output_ : indicate your output description here. \n refers to a new line.
    </out>

"""

import os
files = os.listdir(StudyFolder)
# ---------- end modelica_folder ----------
panel_16 = Panel(gh_cpython)
# Save .mo file
gh_cpython_2 = GH_CPython(FMU=gh_cpython)  # -> Mo; inputs FMU: list; disabled
# ---------- gh_cpython_2: Python ----------
# -*- coding: utf-8 -*-
""" 
Python Script
Created on  Thursday July 2020 12:32:39 
@author:  amd 

[desc]
Description of the plugin Here
Write here any thing... 
[/desc]

ARGUMENTS:
----------
<inp> 
    _input :[required] - [type = int] - [default = None] 
    Descripe your input here 
        * bullet point.
        * bullet point
</inp>
<inp>
    Other inputs go here ...
</inp>

RETURN:
----------
    <out>
        output_ : indicate your output description here. \n refers to a new line.
    </out>

"""
import os 
directory = os.path.dirname(FMU)

from OMPython import ModelicaSystem
mod = ModelicaSystem()
file = mod.convertFmu2Mo(FMU)
Mo = directory + "/" + file
# ---------- end gh_cpython_2 ----------
# Create connectors
panel_17 = Panel(gh_cpython_2)
